# Grasshopper definition Snitch.gh (Grasshopper 1.0.7)
# plug-ins: Grasshopper-Tekla Link 2021.1.14, SnitchGrasshopper

mo = ModelObject(
    [null x4],
    ModelID="Snitch.db1",
    ModelObjectInfos=["Tekla.Structures.Model.Beam, Tekla.Structures.Model, Version=2021.0.0.0, Culture=neutral, PublicKeyToken=2f04dbe497b71114;6a63f968-6984-48d8-b971-c96bd8a8253a", "Tekla.Structures.Model.Beam, Tekla.Structures.Model, Version=2021.0.0.0, Culture=neutral, PublicKeyToken=2f04dbe497b71114;cf33dcb5-fce6-453f-9e7c-739323df8735", "Tekla.Structures.Model.Beam, Tekla.Structures.Model, Version=2021.0.0.0, Culture=neutral, PublicKeyToken=2f04dbe497b71114;5848e280-bf39-445d-8eb1-0b009c9fc7a0", "Tekla.Structures.Model.ContourPlate, Tekla.Structures.Model, Version=2021.0.0.0, Culture=neutral, PublicKeyToken=2f04dbe497b71114;e45d3efb-4cc7-4b19-a8e6-0ce517e0c4b1"])
mo_2 = ModelObject(simplify(graft(mo)))
plt = Plate(mo_2)
beam = Beam(mo_2)
clean = CleanTree(RemoveNulls=True, RemoveInvalid=True, RemoveEmpty=True, Tree=beam)
clean_2 = CleanTree(RemoveNulls=True, RemoveInvalid=True, RemoveEmpty=True, Tree=plt)
debeam = DeconstructBeam(Beam=clean)  # -> Curve, Profile, Attributes, Position, Numbering, Deforming, Type
mesh = ConvertToMesh(TeklaObject=clean, SolidType=2)
deplate = DeconstructPlate(Plate=clean_2)  # -> Boundary, Profile, Attributes, Position, Numbering, Type
mesh_2 = ConvertToMesh(TeklaObject=clean_2, SolidType=2)
cp = ControlPoints(Curve=deplate.Boundary)  # -> Points, Weights, Knots
pshift = ShiftPaths(Data=mesh_2, Offset=-1)
cp_2 = ControlPoints(Curve=debeam.Curve)  # -> Points, Weights, Knots
pshift_2 = ShiftPaths(Data=mesh, Offset=-1)
panel = Panel("PLATE")
pshift_3 = ShiftPaths(Data=cp.Points, Offset=-1)
pshift_4 = ShiftPaths(Data=cp_2.Points, Offset=-1)
tmatch = MatchText(Text=debeam.Type, Pattern="BEAM", Case=True)
tmatch_2 = MatchText(Text=debeam.Type, Pattern="COLUMN", Case=True)
volume = Volume(Geometry=pshift)  # -> Volume, Centroid
tmatch_3 = MatchText(Text=debeam.Type, Pattern="PANEL", Case=True)
panel_2 = Panel("1")
volume_2 = Volume(Geometry=pshift_2)  # -> Volume, Centroid
dispatch = Dispatch(List=pshift_4, DispatchPattern=tmatch)  # -> ListA, ListB
dispatch_2 = Dispatch(List=pshift_4, DispatchPattern=tmatch_2)  # -> ListA, ListB
dispatch_3 = Dispatch(List=pshift_4, DispatchPattern=tmatch_3)  # -> ListA, ListB
clean_3 = CleanTree(
    RemoveNulls=True,
    RemoveInvalid=True,
    RemoveEmpty=True,
    Tree=dispatch_2.ListA,
    SynchronousTree1=volume_2.Volume,
    SynchronousTree2=pshift_2)  # -> Tree, SynchronousTree1, SynchronousTree2
clean_4 = CleanTree(
    RemoveNulls=True,
    RemoveInvalid=True,
    RemoveEmpty=True,
    Tree=dispatch.ListA,
    SynchronousTree1=volume_2.Volume,
    SynchronousTree2=pshift_2)  # -> Tree, SynchronousTree1, SynchronousTree2
clean_5 = CleanTree(
    RemoveNulls=True,
    RemoveInvalid=True,
    RemoveEmpty=True,
    Tree=dispatch_3.ListA,
    SynchronousTree1=volume_2.Volume,
    SynchronousTree2=pshift_2)  # -> Tree, SynchronousTree1, SynchronousTree2
snitch_column = SnitchColumn(Points=clean_3.Tree, Volume=clean_3.SynchronousTree1)
snitch_slab = SnitchSlab(Points=pshift_3, Volume=volume.Volume)
snitch_wall = SnitchWall(Points=clean_5.Tree, Volume=clean_5.SynchronousTree1, Mesh=clean_5.SynchronousTree2)
snitch_beam = SnitchBeam(Points=clean_4.Tree, Volume=clean_4.SynchronousTree1)
